% Simulink data dictionary Navigation.sldd

starTracker_meas = Simulink.Bus()  % star tracker measurements bus
  timestamp: double, Unit="sec"  % measure timestamp
  quaternion: double[4 1]  % measured quaternion

IMU_meas = Simulink.Bus()  % IMU measurements
  acc_timestamp: double, Unit="sec"  % timestamp of acceleration measurement
  gyro_timestamp: double, Unit="sec"  % timestamp of gyroscope measurement
  acc: double[3 1], Unit="m/s^2"  % measured acceleration
  gyro: double[3 1], Unit="rad/s"  % measured angular rates

radio_meas = Simulink.Bus()
  range_PN: double, Unit="m"  % Range measurements using the pseudo-noise signal
  range_CP: double, Unit="m"  % Range measurements using the carrier phase measurement
  range_rate: double, Unit="m/s"  % Range rate measurements
  range_timestamp: double, Unit="s"  % Range timestamp
  range_rate_timestamp: double, Unit="s"  % Range rate timestamp

Measurements = Simulink.Bus()  % Bus containing all the measurements
  radio: Bus: radio_meas
  IMU: Bus: IMU_meas
  starTracker: Bus: starTracker_meas

statesBus = Simulink.Bus()
  x_m: double[3 1], Unit="km"  % Main spacecraft position
  v_m: double[3 1], Unit="km/s"  % Main spacecraft velocity
  q_m: double[4 1]  % Main spacecraft attitude quaternion
  x_b: double[3 1], Unit="km"  % beacon spacecraft position
  v_b: double[3 1], Unit="km/s"  % beacon spacecraft position
  bias_acc: double[3 1], Unit="m/s^2"  % accelerometer bias
  bias_gyro: double[3 1], Unit="rad/s"  % gyroscope bias
  bias_clock: double, Unit="km"  % clock bias
  drift_clock: double, Unit="km/s"  % clock drift

Q = struct(
  description="Process noise matrix",
  value=[1.81409e-14 0 0 0 0 0 0 0 0 0 0 0 0 0 0 0 0 0 0 0
   0 1.963009e-14 0 0 0 0 0 0 0 0 0 0 0 0 0 0 0 0 0 0
   0 0 1.497117e-14 0 0 0 0 0 0 0 0 0 0 0 0 0 0 0 0 0
   0 0 0 1.355237e-17 0 0 0 0 0 0 0 0 0 0 0 0 0 0 0 0
   0 0 0 0 1.96733e-17 0 0 0 0 0 0 0 0 0 0 0 0 0 0 0
   0 0 0 0 0 1.40652e-17 0 0 0 0 0 0 0 0 0 0 0 0 0 0
   0 0 0 0 0 0 1.361111e-12 0 0 0 0 0 0 0 0 0 0 0 0 0
   0 0 0 0 0 0 0 1.361111e-12 0 0 0 0 0 0 0 0 0 0 0 0
   0 0 0 0 0 0 0 0 1.361111e-12 0 0 0 0 0 0 0 0 0 0 0
   0 0 0 0 0 0 0 0 0 1.738507e-16 0 0 0 0 0 0 0 0 0 0
   0 0 0 0 0 0 0 0 0 0 1.738507e-16 0 0 0 0 0 0 0 0 0
   0 0 0 0 0 0 0 0 0 0 0 1.738507e-16 0 0 0 0 0 0 0 0
   0 0 0 0 0 0 0 0 0 0 0 0 1.903859e-09 0 0 0 0 0 0 0
   0 0 0 0 0 0 0 0 0 0 0 0 0 1.903859e-09 0 0 0 0 0 0
   0 0 0 0 0 0 0 0 0 0 0 0 0 0 1.903859e-09 0 0 0 0 0
   0 0 0 0 0 0 0 0 0 0 0 0 0 0 0 8.839917e-16 0 0 0 0
   0 0 0 0 0 0 0 0 0 0 0 0 0 0 0 0 8.839917e-16 0 0 0
   0 0 0 0 0 0 0 0 0 0 0 0 0 0 0 0 0 8.839917e-16 0 0
   0 0 0 0 0 0 0 0 0 0 0 0 0 0 0 0 0 0 2.696266e-18 0
   0 0 0 0 0 0 0 0 0 0 0 0 0 0 0 0 0 0 0 0])

R_ST = struct(
  description="Star tracker measurement noise",
  unit="rad^2",
  value=[9.0e-10 0 0; 0 9.0e-10 0; 0 0 9.0e-10])

StartDate = struct(year=2027, month=1, day=1, hour=0, min=0, sec=0)

Propagation = struct(
  lf=struct(value=5, unit="Hz", description="State propagation frequency"),
  hf=struct(value=30, unit="Hz", description="Higher propagation frequency for IMU error comoensation algorithms"),
  Earth=struct(
    mu=struct(value=398600, unit="km^3/s^2"),
    amp=struct(
      value=[-383000 -31500 -10600 -6200 -3200 -2300 -800
       -351000 -28900 -13700 -9700 -5700 -2900 -2100
       -153200 -31500 -12500 -4200 -2500 -3000 -1800],
      unit="km",
      description="Amplitude coefficients for the position of the simplified earth model"),
    freq=struct(
      value=[8399.685 70.99 16728.377 1185.622 7143.07 15613.745 8467.263
       8399.687 70.997 8433.466 16728.38 1185.667 7143.058 15613.755
       8399.672 8433.464 70.996 16728.364 1185.645 104.881 8399.116],
      unit="Hz",
      description="Frequency coefficients for the position of the simplified earth model"),
    phase=struct(
      value=[5.381 6.169 1.453 0.481 5.017 0.857 1.01
       3.811 4.596 4.766 6.165 5.164 0.3 5.565
       3.807 1.629 4.595 6.162 5.167 2.555 6.248],
      unit="rad",
      description="phase coefficients for the position of the simplified earth model")),
  Moon=struct(
    mu=struct(value=4900.2800238, unit="km^3/s^2"),
    radius=struct(value=1738, unit="km"),
    SH=struct(
      n=struct(value=5, description="degree index"),
      m=struct(value=5, description="order index"),
      Pnm=struct(value=[1 0 1.732051], description="P00, P01, P11"),
      csi=struct(
        value=[0 0 0 0 0 0
         0 0 0 0 0 0
         1.936492 2.236068 0 0 0 0
         1.972027 2.09165 2.645751 0 0 0
         1.984313 2.04939 2.291288 3 0 0
         1.989975 2.03101 2.171241 2.487469 3.316625 0],
        description="coefficients to propagate the Legendre polynomials"),
      eta=struct(
        value=[0 0 0 0 0 0
         0 0 0 0 0 0
         1.118034 0 0 0 0 0
         1.01835 0.9354143 0 0 0 0
         1.006231 0.9797959 0.8660254 0 0 0
         1.002853 0.9910312 0.9476071 0.8291562 0 0],
        description="coefficients to propagate the Legendre polynomials"),
      zeta=struct(
        value=[0 0 0 0 0 0
         0 0 0 0 0 0
         1.732051 2 0 0 0 0
         2.44949 3.162278 2.44949 0 0 0
         3.162278 4.242641 3.741657 2.828427 0 0
         3.872983 5.291503 4.898979 4.242641 3.162278 0],
        description="coefficients to compute the gravitational acceleration"),
      Cnm=struct(
        value=[0 0 0 0 0 0
         0 0 0 0 0 0
         -9.089015e-05 -2.962036e-08 3.463209e-05 0 0 0
         -3.24496e-06 2.638547e-05 1.419184e-05 1.228156e-05 0 0
         3.286678e-06 -5.978221e-06 -7.150751e-06 -1.359494e-06 -6.001626e-06 0
         -2.530739e-07 -1.144613e-06 4.419088e-06 5.473673e-07 2.74319e-06 3.046958e-06],
        description="S.h. sine coefficients"),
      Snm=struct(
        value=[0 0 0 0 0 0
         0 0 0 0 0 0
         0 -2.771463e-08 2.3783e-08 0 0 0
         0 5.511503e-06 4.945406e-06 -1.839432e-06 0 0
         0 1.73215e-06 -6.926699e-06 -1.353789e-05 4.019687e-06 0
         0 -4.213482e-06 9.333326e-07 8.930777e-06 1.745584e-07 -2.875373e-06]),
      Znm=struct(
        value=[0 0 0 0 0 0
         0 0 0 0 0 0
         3.464102 0 0 0 0 0
         7.745967 7.745967 0 0 0 0
         13.41641 15.87451 10.58301 0 0 0
         20.4939 25.92296 20.78461 13.41641 0 0])),
    eul0=struct(
      value=[0.2547045 0.3880776 0.04558641],
      unit="rad",
      description="Initial ZXZ rotation angles from J2000 to MOON_PA"),
    eul_dot=struct(
      value=[2.664488e-06 1.934342e-10 -2.735361e-09],
      unit="rad/s",
      description="Time derivative of the ZXZ rotation angles from J2000 to MOON_PA")))

R_sensor2body = struct(
  value=[0.1268265 -0.7803301 0.6123724; 0.9267767 -0.1268265 -0.3535534; 0.3535534 0.6123724 0.7071068],
  unit="",
  description="Rotation matrix from IMU to body frame")

P0 = struct(
  description="Initial covariance matrix",
  value=[0.01 0 0 0 0 0 0 0 0 0 0 0 0 0 0 0 0 0 0 0 0 0 0
   0 0.01 0 0 0 0 0 0 0 0 0 0 0 0 0 0 0 0 0 0 0 0 0
   0 0 0.01 0 0 0 0 0 0 0 0 0 0 0 0 0 0 0 0 0 0 0 0
   0 0 0 1.0e-8 0 0 0 0 0 0 0 0 0 0 0 0 0 0 0 0 0 0 0
   0 0 0 0 1.0e-8 0 0 0 0 0 0 0 0 0 0 0 0 0 0 0 0 0 0
   0 0 0 0 0 1.0e-8 0 0 0 0 0 0 0 0 0 0 0 0 0 0 0 0 0
   0 0 0 0 0 0 7.615435e-05 0 0 0 0 0 0 0 0 0 0 0 0 0 0 0 0
   0 0 0 0 0 0 0 7.615435e-05 0 0 0 0 0 0 0 0 0 0 0 0 0 0 0
   0 0 0 0 0 0 0 0 7.615435e-05 0 0 0 0 0 0 0 0 0 0 0 0 0 0
   0 0 0 0 0 0 0 0 0 0.01 0 0 0 0 0 0 0 0 0 0 0 0 0
   0 0 0 0 0 0 0 0 0 0 0.01 0 0 0 0 0 0 0 0 0 0 0 0
   0 0 0 0 0 0 0 0 0 0 0 0.01 0 0 0 0 0 0 0 0 0 0 0
   0 0 0 0 0 0 0 0 0 0 0 0 1.0e-8 0 0 0 0 0 0 0 0 0 0
   0 0 0 0 0 0 0 0 0 0 0 0 0 1.0e-8 0 0 0 0 0 0 0 0 0
   0 0 0 0 0 0 0 0 0 0 0 0 0 0 1.0e-8 0 0 0 0 0 0 0 0
   0 0 0 0 0 0 0 0 0 0 0 0 0 0 0 6.014756e-12 0 0 0 0 0 0 0
   0 0 0 0 0 0 0 0 0 0 0 0 0 0 0 0 6.014756e-12 0 0 0 0 0 0
   0 0 0 0 0 0 0 0 0 0 0 0 0 0 0 0 0 6.014756e-12 0 0 0 0 0
   0 0 0 0 0 0 0 0 0 0 0 0 0 0 0 0 0 0 4.178565e-11 0 0 0 0
   0 0 0 0 0 0 0 0 0 0 0 0 0 0 0 0 0 0 0 4.178565e-11 0 0 0
   0 0 0 0 0 0 0 0 0 0 0 0 0 0 0 0 0 0 0 0 4.178565e-11 0 0
   0 0 0 0 0 0 0 0 0 0 0 0 0 0 0 0 0 0 0 0 0 898.7552 0
   0 0 0 0 0 0 0 0 0 0 0 0 0 0 0 0 0 0 0 0 0 0 0.00044039])

x0 = struct(
  value=[1.224647e-13; 2000; 0; -1.106829; 6.777372e-17; 1.106829; -0.2705981; 0.6532815; -0.6532815; -0.2705981; -39287.5; -6.383566; 23560.21; 0.08814962; -0.3665789; -0.02217941; 0; 0; 0; 0; 0; 0; 0; 0],
  description="Initial state. position main [km]; velocity main [km/s]; quaternions [-]; position beacon [km]; velocity beacon [km/s]; bias accelerometer [m/s^2]; bias gyro [rad/s]; bias clock [km]; drift clock [km/s]")