% Simulink data dictionary Sensors.sldd

starTracker = struct(
  nPixel=struct(value=1024, description="number of pixels per side of the sensor", unit=""),
  pixelSize=struct(value=0.005, description="length of one pixel", unit="mm"),
  f=struct(value=29, description="focal length", unit="mm"),
  fov=struct(value=0.1760953, description="field of view", unit="rad"),
  exclusionAngle=struct(
    value=0.6108652,
    description="minimum allowed separation between boresight and sun direction",
    unit="rad"),
  A_BS=struct(
    value=[1 0 0; 0 -1 0; 0 0 -1],
    description="Rotation matrix to transform a vector from sensor to body frame (180 deg rotation around x)",
    unit=""),
  catalogue=struct(
    description="list of unit vectors describing the position of the stars in inertial frame",
    unit="",
    value=[-0.436218 0.1677623 0.8840643 0.03
     0.3471447 0.254538 0.9026079 0.08
     0.3392241 0.03224954 -0.9401526 0.12
     -0.07681528 0.4844016 -0.8714669 0.38
     0.5888224 -0.5000399 -0.6350183 0.46
     0.2923131 0.3185394 0.9017127 0.5
     0.6919831 0.3507139 0.6309985 0.61
     0.6180982 -0.5822032 0.5281988 0.77
     -0.6894844 0.09367696 -0.7182172 0.85
     -0.1802583 0.1987381 -0.9633328 0.96
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     ]),
  maxStars=struct(value=10, unit="", description="Maximum number of stars used for the attitude determination"),
  noise=struct(value=0.1, unit="", description="3sigma error of the centroid coordinates, in pixel lengths"),
  tol=struct(
    unit="rad",
    value=1.0e-8,
    description="maximum angular error allowed for the power method in the quest algorithm"),
  sampleTime=struct(value=1, unit="s", description="Sensor's sample time"))

clock = struct(
  deltaT0=struct(value=0, unit="s", description="Deterministic clock bias"),
  deltaT1=struct(value=7.0e-8, unit="s/s", description="Deterministic clock drift"),
  deltaT2=struct(value=1.0e-16, unit="s/s^2", description="Deterministic clock aging"),
  Tb=struct(value=52.91005, unit="s", description="flicker noise correlation time"),
  N=struct(value=3.162278e-13, unit="s/s^(1/2)", description="Square root of the white noise PSD"),
  K=struct(
    value=5.477226e-15,
    description="square root of the PSD of the white noise driving the brownian noise",
    unit="s/s^(3/2)"),
  Sb=struct(description="Fliker noise's PSD", unit="s^2/s^3", value=9.928022e-28),
  sampleTime=struct(value=0.03333333, unit="s", description="Sensor's sampling time"))

IMU = "IMU"